# Grasshopper definition Tool1.gh (Grasshopper 1.0.8)

# ---- group: INPUT
radius = Slider(30, range=0..100)
height = Slider(20, range=0..100)
# DESCRIPTION: This tool create Cylinder
plane = Plane(PlaneXY(16, 20, 0))

# ----
circle = Circle(Plane=plane, Radius=radius)
unit_z = UnitZ(Factor=height)
extrude = Extrude(Base=circle, Direction=unit_z)
cap_holes = CapHoles(Brep=extrude)

# ---- group: OUTPUT
geometry = Geometry(cap_holes)
