# Grasshopper definition Tools.gh (Grasshopper 1.0.8)

# ---- group: INPUT
radius = Slider(30, range=0..100)
height = Slider(20, range=0..100)
plane = Plane(PlaneXY(16, 20, 0))

# ---- group: draw_square / INPUT
height_2 = Slider(20, range=0..100)
size = Slider(30, range=0..100)
plane_2 = Plane(PlaneXY(16, 20, 0))

# ----
# DESCRIPTION: This tool create Cylinder
name = Panel("draw_cylinder")
circle = Circle(Plane=plane, Radius=radius)
unit_z = UnitZ(Factor=height)
extrude = Extrude(Base=circle, Direction=unit_z)
cap_holes = CapHoles(Brep=extrude)

# ---- group: draw_square
# DESCRIPTION: This tool create Square
name_2 = Panel("draw_square")
rectangle = Rectangle(Plane=plane_2, XSize=size, YSize=size, Radius=0)  # -> Rectangle, Length
unit_z_2 = UnitZ(Factor=height_2)
extrude_2 = Extrude(Base=rectangle.Rectangle, Direction=unit_z_2)
cap_holes_2 = CapHoles(Brep=extrude_2)

# ---- group: OUTPUT
geometry = Geometry(cap_holes)

# ---- group: draw_square / OUTPUT
geometry_2 = Geometry(cap_holes_2)
