# Grasshopper definition Test.gh (Grasshopper 1.0.8)
# plug-ins: ToggleV6, GrasshopperAgent

panel = Panel("C:\Users\baoqt\OneDrive\Documents\GitHub\LangGraphAgent\GHTools")
panel_2 = Panel("C:\Users\Admin\Documents\GitHub\LangGraphAgent\GHTools")
gh_tool_server = GHToolServer(Folder=panel, Port=5100, Active=Toggle(SpecialInteger=True), ShowInCanvas=False, KeepOpen=False, BakeToViewport=True)  # -> Status, Tools, URL, BuiltInTools, GHTools
panel_3 = Panel(gh_tool_server.BuiltInTools)
